# Dynamo graph 3DWireframe_To_RevitModel_Converter.dyn (Dynamo 2.5.0.7460)
# packages: bimorphNodes 3.0.3, Data-Shapes 2021.2.5, Clockwork for Dynamo 2.x 2.3.0

# group: 3D WIREFRAME TO REVIT MODEL CONVERSION
# note: NOTES:
# 1. User can initiate script with Dynamo Player
# 2. Additional Packages: BimorphNodes, Data Shapes
# 3. User to load structural family types required to apply to 3D wireframe.
# 4. User Input using Data Shapes MultipleInputForm++

# group: USER INTERFACE
# note: User Input

# group: Output to UI
code_block = CodeBlock { "3D Wireframe To Revit Conversion"; }
code_block_2 = CodeBlock { "Select"; }
# note: Requests user to select which linked CAD file to process
code_block_3 = CodeBlock { "1. Select Linked CAD File"; }
boolean = BoolSelector(true)
# note: Data Shapes Package
selectmodelelements_data = Custom[SelectModelElements Data](InputName=code_block_3, SelectSingleElement=boolean)  # package Data-Shapes; Creates a Revit element selection input for UI.MultipleInputForm++ . Check out www.data-shapes.net for more infos!
boolean_2 = BoolSelector(true)
code_block_4 = CodeBlock { "Cancel"; }
multipleinputform = Custom[MultipleInputForm ++](Description_optional=code_block, ButtonText_optional=code_block_2, Inputs=selectmodelelements_data, Toggle=boolean_2, CancelButtonText_optional=code_block_4)  # package Data-Shapes; Create a form with multiple inputs. see www.data-shapes.net for tutorials and infos!

# group: Backend Process
# note: Takes user input selection into an easily accessible list
flatten = List.Flatten(list=multipleinputform.User_Inputs)
code_block_5 = CodeBlock { 0; }
getItemAtIndex = List.GetItemAtIndex(list=flatten, index=code_block_5)

# group: User Input
code_block_6 = CodeBlock { "3. Structural Framing Types"; }
# note: Elements to be modeled as Structural Framing
categories = Categories("OST_StructuralFraming")
all_family_types_of_category = Custom[All Family Types Of Category](category=categories)  # package Clockwork for Dynamo 2.x; Gets all family types/symbols of a given category in the model.
# note: Data Shapes Package
dropdown_data = Custom[DropDown Data](InputName=code_block_6, Keys=all_family_types_of_category, Values=all_family_types_of_category)  # package Data-Shapes; Create data for DropDown input in UI.MultiInputForm ++ . Check out www.data-shapes.net for more infos.

# group: User Input
# note: User to Check Box if to apply model category type to 3D line element
boolean_3 = BoolSelector(false)
code_block_7 = CodeBlock { "Check to Model"; }
# note: Data Shapes Package
boolean_input = Custom[Boolean input](DefaultValue=boolean_3, SideText=code_block_7)  # package Data-Shapes; Creates a boolean input for UI.MultipleInputForm ++ . Check out www.data-shapes.net for more infos!

# group: User Input
code_block_8 = CodeBlock { "3. Structural Column Types"; }
# note: Elements to be modeled as Structural Columns
categories_2 = Categories("OST_StructuralColumns")
all_family_types_of_category_2 = Custom[All Family Types Of Category](category=categories_2)
# note: Data Shapes Package
dropdown_data_2 = Custom[DropDown Data](InputName=code_block_8, Keys=all_family_types_of_category_2, Values=all_family_types_of_category_2)

# group: User Input
# note: User to Check Box if to apply model category type to 3D line element
boolean_4 = BoolSelector(false)
code_block_9 = CodeBlock { "Check to Model"; }
# note: Data Shapes Package
boolean_input_2 = Custom[Boolean input](DefaultValue=boolean_4, SideText=code_block_9)

# group: User Input
code_block_10 = CodeBlock { "4. Associated Level"; }
# note: User to assign Revit element associated level
categories_3 = Categories("OST_Levels")
all_elements_of_category = ElementsOfCategory(Category=categories_3)
# note: Data Shapes Package
dropdown_data_3 = Custom[DropDown Data](InputName=code_block_10, Keys=all_elements_of_category, Values=all_elements_of_category)

# group: Output to UI
code_block_11 = CodeBlock { "3D Wireframe To Revit Conversion"; }
# note: Requests user to select which Layer, Structural Type, and Associated Level to model and assign.
code_block_12 = CodeBlock { "2. Select Layer Name"; }
# note: BImorphNodes Package
layerNames = CAD.LayerNames(importInstance=getItemAtIndex)
# note: Data Shapes Package
dropdown_data_4 = Custom[DropDown Data](InputName=code_block_12, Keys=layerNames, Values=layerNames)
list_create = List.Create(item0=dropdown_data_4, item1=dropdown_data, item2=boolean_input, item3=dropdown_data_2, item4=boolean_input_2, item5=dropdown_data_3)
boolean_5 = BoolSelector(true)
code_block_13 = CodeBlock { "Cancel"; }
multipleinputform_2 = Custom[MultipleInputForm ++](Description_optional=code_block_11, Inputs=list_create, Toggle=boolean_5, CancelButtonText_optional=code_block_13)

# group: Backend Process
flatten_2 = List.Flatten(list=multipleinputform_2.User_Inputs)
code_block_14 = CodeBlock { 0; }
# note: Associates which element based on list index has required information
# note: Translates user inputs to apply to newly created Revit element
getItemAtIndex_2 = List.GetItemAtIndex(list=flatten_2, index=code_block_14)
# note: BimorphNodes Package
curvesFromCADLayers = CAD.CurvesFromCADLayers(importInstance=getItemAtIndex, layerNames=getItemAtIndex_2)
flatten_3 = List.Flatten(list=curvesFromCADLayers.Curve)
code_block_15 = CodeBlock { 5; }
getItemAtIndex_3 = List.GetItemAtIndex(list=flatten_2, index=code_block_15)
code_block_16 = CodeBlock { 2; }
getItemAtIndex_4 = List.GetItemAtIndex(list=flatten_2, index=code_block_16)
code_block_17 = CodeBlock { 1; }
getItemAtIndex_5 = List.GetItemAtIndex(list=flatten_2, index=code_block_17)
code_block_18 = CodeBlock { "null"; }
# note: Conditional statment assessing if user checked the box to proceed with modeling element to 3D wireframe
if_ = If(test=getItemAtIndex_4, true=getItemAtIndex_5, false=code_block_18)
code_block_19 = CodeBlock { 4; }
getItemAtIndex_6 = List.GetItemAtIndex(list=flatten_2, index=code_block_19)
code_block_20 = CodeBlock { 3; }
getItemAtIndex_7 = List.GetItemAtIndex(list=flatten_2, index=code_block_20)
code_block_21 = CodeBlock { "null"; }
if_2 = If(test=getItemAtIndex_6, true=getItemAtIndex_7, false=code_block_21)

# group: Output to UI
# note: Generates structural element model from 'Curve' based on user input
beamByCurve = StructuralFraming.BeamByCurve(curve=flatten_3, level=getItemAtIndex_3, structuralFramingType=if_)
columnByCurve = StructuralFraming.ColumnByCurve(curve=flatten_3, level=getItemAtIndex_3, structuralColumnType=if_2)

# group: Output
# note: Indicates which elements were created.
watch = Watch(beamByCurve)
watch_2 = Watch(columnByCurve)
